# Grasshopper definition SynthAnthro_OpenMesh_1.gh (Grasshopper 1.0.8)

list = ValueList({"MALE", "FEMALE"}, selected="FEMALE")
path = FilePath("/Users/briancox/Dropbox/GitHub/MTWABP/Tools/SyntheticAnthropometry/CAESAR/OBJ/")
panel = Panel("0001")
panel_2 = Panel(path)
panel_3 = Panel(list)
pyfourdigitoutput_1 = Python3Script(x=Slider(1796, range=0..5000))  # -> out, a
# ---------- pyfourdigitoutput_1: Python ----------
slider_value = int(x)
a = formatted_string = f"{slider_value:04d}"
# ---------- end pyfourdigitoutput_1 ----------
path_2 = FilePath("/Users/briancox/Dropbox/GitHub/MTWABP/Tools/SyntheticAnthropometry/CAESAR/OBJ/SPRING_MALE/")
panel_4 = Panel(pyfourdigitoutput_1.a)
concat = Concatenate(FragmentA=path_2, FragmentB="SPRING0001.obj")
panel_5 = Panel(concat)
concat_2 = Concatenate(
    FragmentA=panel_2,
    FragmentB="SPRING",
    FragmentC="_",
    FragmentD=panel_3,
    FragmentE="/",
    FragmentF="SPRING",
    FragmentG=panel_4,
    FragmentH=".obj")
panel_6 = Panel(concat_2)
_3dm = Import3DM(File=panel_6, Layer="*", Name="*")
scale = Scale(Geometry=_3dm, Center=Point(0, 0, 0), Factor=Slider(100, range=0..1000))  # -> Geometry, Transform
geo = Geometry(scale.Geometry)
subdmesh = SubDFromMesh(Mesh=geo, Creases=1, Corners=1, Interpolate=False)
