# Grasshopper definition SynthAnthro_SkeletalModel_2.gh (Grasshopper 1.0.8)

list = ValueList({"MALE", "FEMALE"}, selected="FEMALE")
path = FilePath("/Users/briancox/Dropbox/GitHub/MTWABP/Tools/SyntheticAnthropometry/CAESAR/OBJ/")
pyfourdigitoutput_1 = Python3Script(inputPath=path, inputGender=list, inputSlider=Slider(72, range=0..5000))  # -> out, outputFilePath
# ---------- pyfourdigitoutput_1: Python ----------
inputNumber = int(inputSlider)
outputFilePath = f"{inputPath}SPRING_{inputGender}/SPRING{inputNumber:04d}.obj"
# ---------- end pyfourdigitoutput_1 ----------
panel = Panel(pyfourdigitoutput_1.outputFilePath)
_3dm = Import3DM(File=pyfourdigitoutput_1.outputFilePath, Layer="*", Name="*")
scale = Scale(Geometry=_3dm, Center=Point(0, 0, 0), Factor=Slider(1000, range=0..1000))  # -> Geometry, Transform
geo = Geometry(scale.Geometry)
demesh = DeconstructMesh(Mesh=geo)  # -> Vertices, Faces, Colours, Normals

# ---- group: SHOULDER POMS
item = ListItem(List=demesh.Vertices, Index="10681", Wrap=True)
item_2 = ListItem(List=demesh.Vertices, Index="10559", Wrap=True)
ln = Line(StartPoint=item, EndPoint=item_2)

# ---- group: HIP POMS
item_3 = ListItem(List=demesh.Vertices, Index="5965", Wrap=True)
item_4 = ListItem(List=demesh.Vertices, Index="6025", Wrap=True)
ln_2 = Line(StartPoint=item_3, EndPoint=item_4)

# ---- group: FOOT POMS
item_5 = ListItem(List=demesh.Vertices, Index="282", Wrap=True)
item_6 = ListItem(List=demesh.Vertices, Index="235", Wrap=True)

# ----
pt = Point(<point referenced from the Rhino model>)
cp = ClosestPoint(Point=pt, Cloud=demesh.Vertices)  # -> ClosestPoint, CPIndex, Distance
panel_2 = Panel(cp.CPIndex)

# ---- group: LEGS
midpt = CurveMiddle(Curve=ln_2)
midpt_2 = CurveMiddle(Curve=ln_2)
ln_3 = Line(StartPoint=item_3, EndPoint=midpt)
ln_4 = Line(StartPoint=item_4, EndPoint=midpt_2)
midpt_3 = CurveMiddle(Curve=ln_4)
midpt_4 = CurveMiddle(Curve=ln_3)
ln_5 = Line(StartPoint=midpt_4, EndPoint=item_5)
ln_6 = Line(StartPoint=midpt_3, EndPoint=item_6)

# ---- group: TORSO
midpt_5 = CurveMiddle(Curve=ln)
midpt_6 = CurveMiddle(Curve=ln_2)
ln_7 = Line(StartPoint=midpt_5, EndPoint=midpt_6)

# ---- group: HEAD AND NECK
item_7 = ListItem(List=demesh.Vertices, Index="12456", Wrap=True)
item_8 = ListItem(List=demesh.Vertices, Index="11115", Wrap=True)
item_9 = ListItem(List=demesh.Vertices, Index="11293", Wrap=True)
ln_8 = Line(StartPoint=item_8, EndPoint=item_9)
midpt_7 = CurveMiddle(Curve=ln_8)
ln_9 = Line(StartPoint=midpt_5, EndPoint=midpt_7)
ln_10 = Line(StartPoint=item_7, EndPoint=midpt_7)
