# Grasshopper definition SynthAnthro_SkeletalModel_3.gh (Grasshopper 1.0.8)

list = ValueList({"MALE", "FEMALE"}, selected="FEMALE")
path = FilePath("/Users/briancox/Dropbox/GitHub/MTWABP/Tools/SyntheticAnthropometry/CAESAR/OBJ/")
pyfourdigitoutput_1 = Python3Script(inputPath=path, inputGender=list, inputSlider=Slider(72, range=0..5000))  # -> out, outputFilePath
# ---------- pyfourdigitoutput_1: Python ----------
inputNumber = int(inputSlider)
outputFilePath = f"{inputPath}SPRING_{inputGender}/SPRING{inputNumber:04d}.obj"
# ---------- end pyfourdigitoutput_1 ----------
panel = Panel(pyfourdigitoutput_1.outputFilePath)
_3dm = Import3DM(File=pyfourdigitoutput_1.outputFilePath, Layer="*", Name="*")
scale = Scale(Geometry=_3dm, Center=Point(0, 0, 0), Factor=Slider(1000, range=0..1000))  # -> Geometry, Transform
geo = Geometry(scale.Geometry)
demesh = DeconstructMesh(Mesh=geo)  # -> Vertices, Faces, Colours, Normals
pt = Point(<point referenced from the Rhino model>)
cp = ClosestPoint(Point=pt, Cloud=demesh.Vertices)  # -> ClosestPoint, CPIndex, Distance
panel_2 = Panel(cp.CPIndex)

# ---- group: CIRC_HEAD
item = ListItem(List=demesh.Vertices, Index="12134", Wrap=True)
item_2 = ListItem(List=demesh.Vertices, Index="12082", Wrap=True)
item_3 = ListItem(List=demesh.Vertices, Index="12099", Wrap=True)
item_4 = ListItem(List=demesh.Vertices, Index="12116", Wrap=True)
item_5 = ListItem(List=demesh.Vertices, Index="11890", Wrap=True)
item_6 = ListItem(List=demesh.Vertices, Index="11997", Wrap=True)
item_7 = ListItem(List=demesh.Vertices, Index="12019", Wrap=True)
item_8 = ListItem(List=demesh.Vertices, Index="12047", Wrap=True)
item_9 = ListItem(List=demesh.Vertices, Index="12064", Wrap=True)
item_10 = ListItem(List=demesh.Vertices, Index="12050", Wrap=True)
item_11 = ListItem(List=demesh.Vertices, Index="12006", Wrap=True)
item_12 = ListItem(List=demesh.Vertices, Index="12036", Wrap=True)
ln = Line(StartPoint=item, EndPoint=item_2)
ln_2 = Line(StartPoint=item_2, EndPoint=item_4)
ln_3 = Line(StartPoint=item_3, EndPoint=item_5)
ln_4 = Line(StartPoint=item_4, EndPoint=item_3)
ln_5 = Line(StartPoint=item_5, EndPoint=item_6)
ln_6 = Line(StartPoint=item_6, EndPoint=item_9)
ln_7 = Line(StartPoint=item_7, EndPoint=item_8)
ln_8 = Line(StartPoint=item_8, EndPoint=item_10)
ln_9 = Line(StartPoint=item_10, EndPoint=item_12)
ln_10 = Line(StartPoint=item_9, EndPoint=item_7)
ln_11 = Line(StartPoint=item_11, EndPoint=item)
ln_12 = Line(StartPoint=item_12, EndPoint=item_11)

# ---- group: CIRC_CHEST
item_13 = ListItem(List=demesh.Vertices, Index="9139", Wrap=True)
item_14 = ListItem(List=demesh.Vertices, Index="9310", Wrap=True)
item_15 = ListItem(List=demesh.Vertices, Index="8907", Wrap=True)
item_16 = ListItem(List=demesh.Vertices, Index="9285", Wrap=True)
item_17 = ListItem(List=demesh.Vertices, Index="8833", Wrap=True)
item_18 = ListItem(List=demesh.Vertices, Index="8752", Wrap=True)
item_19 = ListItem(List=demesh.Vertices, Index="8422", Wrap=True)
item_20 = ListItem(List=demesh.Vertices, Index="8416", Wrap=True)
item_21 = ListItem(List=demesh.Vertices, Index="8666", Wrap=True)
item_22 = ListItem(List=demesh.Vertices, Index="8442", Wrap=True)
item_23 = ListItem(List=demesh.Vertices, Index="8736", Wrap=True)
item_24 = ListItem(List=demesh.Vertices, Index="8802", Wrap=True)
item_25 = ListItem(List=demesh.Vertices, Index="8718", Wrap=True)
item_26 = ListItem(List=demesh.Vertices, Index="8887", Wrap=True)
item_27 = ListItem(List=demesh.Vertices, Index="9054", Wrap=True)
item_28 = ListItem(List=demesh.Vertices, Index="9084", Wrap=True)
ln_13 = Line(StartPoint=item_13, EndPoint=item_14)
ln_14 = Line(StartPoint=item_14, EndPoint=item_16)
ln_15 = Line(StartPoint=item_15, EndPoint=item_17)
ln_16 = Line(StartPoint=item_16, EndPoint=item_15)
ln_17 = Line(StartPoint=item_17, EndPoint=item_18)
ln_18 = Line(StartPoint=item_18, EndPoint=item_21)
ln_19 = Line(StartPoint=item_19, EndPoint=item_20)
ln_20 = Line(StartPoint=item_20, EndPoint=item_22)
ln_21 = Line(StartPoint=item_22, EndPoint=item_25)
ln_22 = Line(StartPoint=item_21, EndPoint=item_19)
ln_23 = Line(StartPoint=item_23, EndPoint=item_24)
ln_24 = Line(StartPoint=item_24, EndPoint=item_26)
ln_25 = Line(StartPoint=item_26, EndPoint=item_28)
ln_26 = Line(StartPoint=item_25, EndPoint=item_23)
ln_27 = Line(StartPoint=item_27, EndPoint=item_13)
ln_28 = Line(StartPoint=item_28, EndPoint=item_27)

# ---- group: CIRC_BICEP_LEFT
item_29 = ListItem(List=demesh.Vertices, Index="9401", Wrap=True)
item_30 = ListItem(List=demesh.Vertices, Index="9764", Wrap=True)
item_31 = ListItem(List=demesh.Vertices, Index="9250", Wrap=True)
item_32 = ListItem(List=demesh.Vertices, Index="9555", Wrap=True)
item_33 = ListItem(List=demesh.Vertices, Index="9167", Wrap=True)
item_34 = ListItem(List=demesh.Vertices, Index="9245", Wrap=True)
item_35 = ListItem(List=demesh.Vertices, Index="9389", Wrap=True)
item_36 = ListItem(List=demesh.Vertices, Index="9143", Wrap=True)
ln_29 = Line(StartPoint=item_29, EndPoint=item_30)
ln_30 = Line(StartPoint=item_30, EndPoint=item_32)
ln_31 = Line(StartPoint=item_31, EndPoint=item_33)
ln_32 = Line(StartPoint=item_32, EndPoint=item_31)
ln_33 = Line(StartPoint=item_33, EndPoint=item_34)
ln_34 = Line(StartPoint=item_34, EndPoint=item_36)
ln_35 = Line(StartPoint=item_35, EndPoint=item_29)
ln_36 = Line(StartPoint=item_36, EndPoint=item_35)

# ---- group: CIRC_THIGH_LEFT
item_37 = ListItem(List=demesh.Vertices, Index="3390", Wrap=True)
item_38 = ListItem(List=demesh.Vertices, Index="3347", Wrap=True)
item_39 = ListItem(List=demesh.Vertices, Index="3387", Wrap=True)
item_40 = ListItem(List=demesh.Vertices, Index="3363", Wrap=True)
item_41 = ListItem(List=demesh.Vertices, Index="3376", Wrap=True)
item_42 = ListItem(List=demesh.Vertices, Index="3319", Wrap=True)
item_43 = ListItem(List=demesh.Vertices, Index="3324", Wrap=True)
item_44 = ListItem(List=demesh.Vertices, Index="3336", Wrap=True)
ln_37 = Line(StartPoint=item_37, EndPoint=item_38)
ln_38 = Line(StartPoint=item_38, EndPoint=item_40)
ln_39 = Line(StartPoint=item_39, EndPoint=item_41)
ln_40 = Line(StartPoint=item_40, EndPoint=item_39)
ln_41 = Line(StartPoint=item_41, EndPoint=item_42)
ln_42 = Line(StartPoint=item_42, EndPoint=item_44)
ln_43 = Line(StartPoint=item_43, EndPoint=item_37)
ln_44 = Line(StartPoint=item_44, EndPoint=item_43)

# ---- group: CIRC_HEAD
item_45 = ListItem(List=demesh.Vertices, Index="10872", Wrap=True)
item_46 = ListItem(List=demesh.Vertices, Index="10963", Wrap=True)
item_47 = ListItem(List=demesh.Vertices, Index="11096", Wrap=True)
item_48 = ListItem(List=demesh.Vertices, Index="11054", Wrap=True)
item_49 = ListItem(List=demesh.Vertices, Index="11174", Wrap=True)
item_50 = ListItem(List=demesh.Vertices, Index="11179", Wrap=True)
item_51 = ListItem(List=demesh.Vertices, Index="11132", Wrap=True)
item_52 = ListItem(List=demesh.Vertices, Index="11109", Wrap=True)
item_53 = ListItem(List=demesh.Vertices, Index="11160", Wrap=True)
item_54 = ListItem(List=demesh.Vertices, Index="11037", Wrap=True)
item_55 = ListItem(List=demesh.Vertices, Index="10868", Wrap=True)
item_56 = ListItem(List=demesh.Vertices, Index="10953", Wrap=True)
ln_45 = Line(StartPoint=item_45, EndPoint=item_46)
ln_46 = Line(StartPoint=item_46, EndPoint=item_48)
ln_47 = Line(StartPoint=item_47, EndPoint=item_49)
ln_48 = Line(StartPoint=item_48, EndPoint=item_47)
ln_49 = Line(StartPoint=item_49, EndPoint=item_50)
ln_50 = Line(StartPoint=item_50, EndPoint=item_53)
ln_51 = Line(StartPoint=item_51, EndPoint=item_52)
ln_52 = Line(StartPoint=item_52, EndPoint=item_54)
ln_53 = Line(StartPoint=item_54, EndPoint=item_56)
ln_54 = Line(StartPoint=item_53, EndPoint=item_51)
ln_55 = Line(StartPoint=item_55, EndPoint=item_45)
ln_56 = Line(StartPoint=item_56, EndPoint=item_55)

# ---- group: CIRC_WAIST
item_57 = ListItem(List=demesh.Vertices, Index="7111", Wrap=True)
item_58 = ListItem(List=demesh.Vertices, Index="7086", Wrap=True)
item_59 = ListItem(List=demesh.Vertices, Index="7300", Wrap=True)
item_60 = ListItem(List=demesh.Vertices, Index="7207", Wrap=True)
item_61 = ListItem(List=demesh.Vertices, Index="7488", Wrap=True)
item_62 = ListItem(List=demesh.Vertices, Index="7472", Wrap=True)
item_63 = ListItem(List=demesh.Vertices, Index="7423", Wrap=True)
item_64 = ListItem(List=demesh.Vertices, Index="7269", Wrap=True)
item_65 = ListItem(List=demesh.Vertices, Index="7467", Wrap=True)
item_66 = ListItem(List=demesh.Vertices, Index="7158", Wrap=True)
item_67 = ListItem(List=demesh.Vertices, Index="7295", Wrap=True)
item_68 = ListItem(List=demesh.Vertices, Index="7229", Wrap=True)
item_69 = ListItem(List=demesh.Vertices, Index="7265", Wrap=True)
item_70 = ListItem(List=demesh.Vertices, Index="7112", Wrap=True)
item_71 = ListItem(List=demesh.Vertices, Index="7104", Wrap=True)
item_72 = ListItem(List=demesh.Vertices, Index="7089", Wrap=True)
ln_57 = Line(StartPoint=item_57, EndPoint=item_58)
ln_58 = Line(StartPoint=item_58, EndPoint=item_60)
ln_59 = Line(StartPoint=item_59, EndPoint=item_61)
ln_60 = Line(StartPoint=item_60, EndPoint=item_59)
ln_61 = Line(StartPoint=item_61, EndPoint=item_62)
ln_62 = Line(StartPoint=item_62, EndPoint=item_65)
ln_63 = Line(StartPoint=item_63, EndPoint=item_64)
ln_64 = Line(StartPoint=item_64, EndPoint=item_66)
ln_65 = Line(StartPoint=item_66, EndPoint=item_69)
ln_66 = Line(StartPoint=item_65, EndPoint=item_63)
ln_67 = Line(StartPoint=item_67, EndPoint=item_68)
ln_68 = Line(StartPoint=item_68, EndPoint=item_70)
ln_69 = Line(StartPoint=item_70, EndPoint=item_72)
ln_70 = Line(StartPoint=item_69, EndPoint=item_67)
ln_71 = Line(StartPoint=item_71, EndPoint=item_57)
ln_72 = Line(StartPoint=item_72, EndPoint=item_71)

# ---- group: HIP POMS
item_73 = ListItem(List=demesh.Vertices, Index="5965", Wrap=True)
item_74 = ListItem(List=demesh.Vertices, Index="6025", Wrap=True)
ln_73 = Line(StartPoint=item_73, EndPoint=item_74)

# ---- group: CIRC_BICEP_RIGHT
item_75 = ListItem(List=demesh.Vertices, Index="9165", Wrap=True)
item_76 = ListItem(List=demesh.Vertices, Index="9063", Wrap=True)
item_77 = ListItem(List=demesh.Vertices, Index="9067", Wrap=True)
item_78 = ListItem(List=demesh.Vertices, Index="9079", Wrap=True)
item_79 = ListItem(List=demesh.Vertices, Index="9189", Wrap=True)
item_80 = ListItem(List=demesh.Vertices, Index="9469", Wrap=True)
item_81 = ListItem(List=demesh.Vertices, Index="9377", Wrap=True)
item_82 = ListItem(List=demesh.Vertices, Index="9495", Wrap=True)
ln_74 = Line(StartPoint=item_75, EndPoint=item_76)
ln_75 = Line(StartPoint=item_76, EndPoint=item_78)
ln_76 = Line(StartPoint=item_77, EndPoint=item_79)
ln_77 = Line(StartPoint=item_78, EndPoint=item_77)
ln_78 = Line(StartPoint=item_79, EndPoint=item_80)
ln_79 = Line(StartPoint=item_80, EndPoint=item_82)
ln_80 = Line(StartPoint=item_81, EndPoint=item_75)
ln_81 = Line(StartPoint=item_82, EndPoint=item_81)

# ---- group: CIRC_THIGH_RIGHT
item_83 = ListItem(List=demesh.Vertices, Index="3313", Wrap=True)
item_84 = ListItem(List=demesh.Vertices, Index="3305", Wrap=True)
item_85 = ListItem(List=demesh.Vertices, Index="3296", Wrap=True)
item_86 = ListItem(List=demesh.Vertices, Index="3331", Wrap=True)
item_87 = ListItem(List=demesh.Vertices, Index="3337", Wrap=True)
item_88 = ListItem(List=demesh.Vertices, Index="3356", Wrap=True)
item_89 = ListItem(List=demesh.Vertices, Index="3342", Wrap=True)
item_90 = ListItem(List=demesh.Vertices, Index="3302", Wrap=True)
ln_82 = Line(StartPoint=item_83, EndPoint=item_84)
ln_83 = Line(StartPoint=item_84, EndPoint=item_86)
ln_84 = Line(StartPoint=item_85, EndPoint=item_87)
ln_85 = Line(StartPoint=item_86, EndPoint=item_85)
ln_86 = Line(StartPoint=item_87, EndPoint=item_88)
ln_87 = Line(StartPoint=item_88, EndPoint=item_90)
ln_88 = Line(StartPoint=item_89, EndPoint=item_83)
ln_89 = Line(StartPoint=item_90, EndPoint=item_89)

# ---- group: SHOULDER POMS
item_91 = ListItem(List=demesh.Vertices, Index="10681", Wrap=True)
item_92 = ListItem(List=demesh.Vertices, Index="10559", Wrap=True)
ln_90 = Line(StartPoint=item_91, EndPoint=item_92)

# ---- group: KNEES
item_93 = ListItem(List=demesh.Vertices, Index="2826", Wrap=True)
item_94 = ListItem(List=demesh.Vertices, Index="2573", Wrap=True)
item_95 = ListItem(List=demesh.Vertices, Index="2645", Wrap=True)
item_96 = ListItem(List=demesh.Vertices, Index="2461", Wrap=True)
ln_91 = Line(StartPoint=item_95, EndPoint=item_96)
ln_92 = Line(StartPoint=item_93, EndPoint=item_94)
midpt = CurveMiddle(Curve=ln_92)
midpt_2 = CurveMiddle(Curve=ln_91)

# ---- group: FEET
item_97 = ListItem(List=demesh.Vertices, Index="451", Wrap=True)
item_98 = ListItem(List=demesh.Vertices, Index="282", Wrap=True)
item_99 = ListItem(List=demesh.Vertices, Index="361", Wrap=True)
item_100 = ListItem(List=demesh.Vertices, Index="235", Wrap=True)
ln_93 = Line(StartPoint=item_98, EndPoint=item_97)
ln_94 = Line(StartPoint=item_100, EndPoint=item_99)

# ---- group: TORSO
midpt_3 = CurveMiddle(Curve=ln_90)
midpt_4 = CurveMiddle(Curve=ln_73)
ln_95 = Line(StartPoint=midpt_3, EndPoint=midpt_4)

# ---- group: HEAD AND NECK
item_101 = ListItem(List=demesh.Vertices, Index="12456", Wrap=True)
item_102 = ListItem(List=demesh.Vertices, Index="11115", Wrap=True)
item_103 = ListItem(List=demesh.Vertices, Index="11293", Wrap=True)
ln_96 = Line(StartPoint=item_102, EndPoint=item_103)
midpt_5 = CurveMiddle(Curve=ln_96)
ln_97 = Line(StartPoint=midpt_3, EndPoint=midpt_5)
ln_98 = Line(StartPoint=item_101, EndPoint=midpt_5)

# ----
item_104 = ListItem(List=demesh.Vertices, Index="12497", Wrap=True)
ln_99 = Line(StartPoint=midpt_4, EndPoint=item_104)

# ---- group: CIRC_FOREARM_LEFT
item_105 = ListItem(List=demesh.Vertices, Index="7778", Wrap=True)
item_106 = ListItem(List=demesh.Vertices, Index="7861", Wrap=True)
item_107 = ListItem(List=demesh.Vertices, Index="7858", Wrap=True)
item_108 = ListItem(List=demesh.Vertices, Index="8038", Wrap=True)
item_109 = ListItem(List=demesh.Vertices, Index="7712", Wrap=True)
item_110 = ListItem(List=demesh.Vertices, Index="7550", Wrap=True)
item_111 = ListItem(List=demesh.Vertices, Index="7587", Wrap=True)
item_112 = ListItem(List=demesh.Vertices, Index="7518", Wrap=True)
ln_100 = Line(StartPoint=item_105, EndPoint=item_106)
ln_101 = Line(StartPoint=item_106, EndPoint=item_108)
ln_102 = Line(StartPoint=item_107, EndPoint=item_109)
ln_103 = Line(StartPoint=item_108, EndPoint=item_107)
ln_104 = Line(StartPoint=item_109, EndPoint=item_110)
ln_105 = Line(StartPoint=item_110, EndPoint=item_112)
ln_106 = Line(StartPoint=item_111, EndPoint=item_105)
ln_107 = Line(StartPoint=item_112, EndPoint=item_111)

# ---- group: CIRC_CALF_LEFT
item_113 = ListItem(List=demesh.Vertices, Index="1904", Wrap=True)
item_114 = ListItem(List=demesh.Vertices, Index="1896", Wrap=True)
item_115 = ListItem(List=demesh.Vertices, Index="1934", Wrap=True)
item_116 = ListItem(List=demesh.Vertices, Index="1906", Wrap=True)
item_117 = ListItem(List=demesh.Vertices, Index="1910", Wrap=True)
item_118 = ListItem(List=demesh.Vertices, Index="1873", Wrap=True)
item_119 = ListItem(List=demesh.Vertices, Index="1878", Wrap=True)
item_120 = ListItem(List=demesh.Vertices, Index="1891", Wrap=True)
ln_108 = Line(StartPoint=item_113, EndPoint=item_114)
ln_109 = Line(StartPoint=item_114, EndPoint=item_116)
ln_110 = Line(StartPoint=item_115, EndPoint=item_117)
ln_111 = Line(StartPoint=item_116, EndPoint=item_115)
ln_112 = Line(StartPoint=item_117, EndPoint=item_118)
ln_113 = Line(StartPoint=item_118, EndPoint=item_120)
ln_114 = Line(StartPoint=item_119, EndPoint=item_113)
ln_115 = Line(StartPoint=item_120, EndPoint=item_119)

# ---- group: CIRC_HIP
item_121 = ListItem(List=demesh.Vertices, Index="6411", Wrap=True)
item_122 = ListItem(List=demesh.Vertices, Index="6467", Wrap=True)
item_123 = ListItem(List=demesh.Vertices, Index="6390", Wrap=True)
item_124 = ListItem(List=demesh.Vertices, Index="6468", Wrap=True)
item_125 = ListItem(List=demesh.Vertices, Index="6275", Wrap=True)
item_126 = ListItem(List=demesh.Vertices, Index="6239", Wrap=True)
item_127 = ListItem(List=demesh.Vertices, Index="6203", Wrap=True)
item_128 = ListItem(List=demesh.Vertices, Index="5940", Wrap=True)
item_129 = ListItem(List=demesh.Vertices, Index="6338", Wrap=True)
item_130 = ListItem(List=demesh.Vertices, Index="5852", Wrap=True)
item_131 = ListItem(List=demesh.Vertices, Index="6112", Wrap=True)
item_132 = ListItem(List=demesh.Vertices, Index="6217", Wrap=True)
item_133 = ListItem(List=demesh.Vertices, Index="5966", Wrap=True)
item_134 = ListItem(List=demesh.Vertices, Index="6225", Wrap=True)
item_135 = ListItem(List=demesh.Vertices, Index="6291", Wrap=True)
item_136 = ListItem(List=demesh.Vertices, Index="6161", Wrap=True)
ln_116 = Line(StartPoint=item_121, EndPoint=item_122)
ln_117 = Line(StartPoint=item_122, EndPoint=item_124)
ln_118 = Line(StartPoint=item_123, EndPoint=item_125)
ln_119 = Line(StartPoint=item_124, EndPoint=item_123)
ln_120 = Line(StartPoint=item_125, EndPoint=item_126)
ln_121 = Line(StartPoint=item_126, EndPoint=item_129)
ln_122 = Line(StartPoint=item_127, EndPoint=item_128)
ln_123 = Line(StartPoint=item_128, EndPoint=item_130)
ln_124 = Line(StartPoint=item_130, EndPoint=item_133)
ln_125 = Line(StartPoint=item_129, EndPoint=item_127)
ln_126 = Line(StartPoint=item_131, EndPoint=item_132)
ln_127 = Line(StartPoint=item_132, EndPoint=item_134)
ln_128 = Line(StartPoint=item_134, EndPoint=item_136)
ln_129 = Line(StartPoint=item_133, EndPoint=item_131)
ln_130 = Line(StartPoint=item_135, EndPoint=item_121)
ln_131 = Line(StartPoint=item_136, EndPoint=item_135)

# ---- group: LEGS
ln_132 = Line(StartPoint=midpt_4, EndPoint=item_73)
ln_133 = Line(StartPoint=midpt_4, EndPoint=item_74)
ln_134 = Line(StartPoint=midpt, EndPoint=item_98)
ln_135 = Line(StartPoint=midpt_2, EndPoint=item_100)
midpt_6 = CurveMiddle(Curve=ln_132)
midpt_7 = CurveMiddle(Curve=ln_133)
ln_136 = Line(StartPoint=midpt_6, EndPoint=midpt)
ln_137 = Line(StartPoint=midpt_7, EndPoint=midpt_2)

# ---- group: CIRC_FOREARM_RIGHT
item_137 = ListItem(List=demesh.Vertices, Index="7863", Wrap=True)
item_138 = ListItem(List=demesh.Vertices, Index="7827", Wrap=True)
item_139 = ListItem(List=demesh.Vertices, Index="7866", Wrap=True)
item_140 = ListItem(List=demesh.Vertices, Index="7714", Wrap=True)
item_141 = ListItem(List=demesh.Vertices, Index="7859", Wrap=True)
item_142 = ListItem(List=demesh.Vertices, Index="8015", Wrap=True)
item_143 = ListItem(List=demesh.Vertices, Index="8030", Wrap=True)
item_144 = ListItem(List=demesh.Vertices, Index="8110", Wrap=True)
ln_138 = Line(StartPoint=item_137, EndPoint=item_138)
ln_139 = Line(StartPoint=item_138, EndPoint=item_140)
ln_140 = Line(StartPoint=item_139, EndPoint=item_141)
ln_141 = Line(StartPoint=item_140, EndPoint=item_139)
ln_142 = Line(StartPoint=item_141, EndPoint=item_142)
ln_143 = Line(StartPoint=item_142, EndPoint=item_144)
ln_144 = Line(StartPoint=item_143, EndPoint=item_137)
ln_145 = Line(StartPoint=item_144, EndPoint=item_143)

# ---- group: CIRC_CALF_RIGHT
item_145 = ListItem(List=demesh.Vertices, Index="1907", Wrap=True)
item_146 = ListItem(List=demesh.Vertices, Index="1861", Wrap=True)
item_147 = ListItem(List=demesh.Vertices, Index="1835", Wrap=True)
item_148 = ListItem(List=demesh.Vertices, Index="1867", Wrap=True)
item_149 = ListItem(List=demesh.Vertices, Index="1828", Wrap=True)
item_150 = ListItem(List=demesh.Vertices, Index="1863", Wrap=True)
item_151 = ListItem(List=demesh.Vertices, Index="1858", Wrap=True)
item_152 = ListItem(List=demesh.Vertices, Index="1868", Wrap=True)
ln_146 = Line(StartPoint=item_145, EndPoint=item_146)
ln_147 = Line(StartPoint=item_146, EndPoint=item_148)
ln_148 = Line(StartPoint=item_147, EndPoint=item_149)
ln_149 = Line(StartPoint=item_148, EndPoint=item_147)
ln_150 = Line(StartPoint=item_149, EndPoint=item_150)
ln_151 = Line(StartPoint=item_150, EndPoint=item_152)
ln_152 = Line(StartPoint=item_151, EndPoint=item_145)
ln_153 = Line(StartPoint=item_152, EndPoint=item_151)

# ---- group: WIDTH_FOOT
item_153 = ListItem(List=demesh.Vertices, Index="369", Wrap=True)
item_154 = ListItem(List=demesh.Vertices, Index="358", Wrap=True)
item_155 = ListItem(List=demesh.Vertices, Index="365", Wrap=True)
item_156 = ListItem(List=demesh.Vertices, Index="723", Wrap=True)
ln_154 = Line(StartPoint=item_153, EndPoint=item_154)
ln_155 = Line(StartPoint=item_155, EndPoint=item_156)

# ---- group: LENGTH_ARMS
item_157 = ListItem(List=demesh.Vertices, Index="8993", Wrap=True)
item_158 = ListItem(List=demesh.Vertices, Index="6859", Wrap=True)
item_159 = ListItem(List=demesh.Vertices, Index="8723", Wrap=True)
item_160 = ListItem(List=demesh.Vertices, Index="6220", Wrap=True)
ln_156 = Line(StartPoint=item_91, EndPoint=item_157)
ln_157 = Line(StartPoint=item_157, EndPoint=item_158)
ln_158 = Line(StartPoint=item_159, EndPoint=item_160)
ln_159 = Line(StartPoint=item_92, EndPoint=item_159)

# ---- group: CIRC_FOOT_LEFT
item_161 = ListItem(List=demesh.Vertices, Index="1027", Wrap=True)
item_162 = ListItem(List=demesh.Vertices, Index="963", Wrap=True)
item_163 = ListItem(List=demesh.Vertices, Index="364", Wrap=True)
item_164 = ListItem(List=demesh.Vertices, Index="820", Wrap=True)
item_165 = ListItem(List=demesh.Vertices, Index="170", Wrap=True)
item_166 = ListItem(List=demesh.Vertices, Index="514", Wrap=True)
item_167 = ListItem(List=demesh.Vertices, Index="953", Wrap=True)
item_168 = ListItem(List=demesh.Vertices, Index="831", Wrap=True)
ln_160 = Line(StartPoint=item_161, EndPoint=item_162)
ln_161 = Line(StartPoint=item_162, EndPoint=item_164)
ln_162 = Line(StartPoint=item_163, EndPoint=item_165)
ln_163 = Line(StartPoint=item_164, EndPoint=item_163)
ln_164 = Line(StartPoint=item_165, EndPoint=item_166)
ln_165 = Line(StartPoint=item_166, EndPoint=item_168)
ln_166 = Line(StartPoint=item_167, EndPoint=item_161)
ln_167 = Line(StartPoint=item_168, EndPoint=item_167)

# ---- group: CIRC_FOOT_RIGHT
item_169 = ListItem(List=demesh.Vertices, Index="1062", Wrap=True)
item_170 = ListItem(List=demesh.Vertices, Index="956", Wrap=True)
item_171 = ListItem(List=demesh.Vertices, Index="330", Wrap=True)
item_172 = ListItem(List=demesh.Vertices, Index="731", Wrap=True)
item_173 = ListItem(List=demesh.Vertices, Index="24", Wrap=True)
item_174 = ListItem(List=demesh.Vertices, Index="309", Wrap=True)
item_175 = ListItem(List=demesh.Vertices, Index="1042", Wrap=True)
item_176 = ListItem(List=demesh.Vertices, Index="789", Wrap=True)
ln_168 = Line(StartPoint=item_169, EndPoint=item_170)
ln_169 = Line(StartPoint=item_170, EndPoint=item_172)
ln_170 = Line(StartPoint=item_171, EndPoint=item_173)
ln_171 = Line(StartPoint=item_172, EndPoint=item_171)
ln_172 = Line(StartPoint=item_173, EndPoint=item_174)
ln_173 = Line(StartPoint=item_174, EndPoint=item_176)
ln_174 = Line(StartPoint=item_175, EndPoint=item_169)
ln_175 = Line(StartPoint=item_176, EndPoint=item_175)
