# Grasshopper definition SynthAnthro_VertexFromPoint_2.gh (Grasshopper 1.0.8)

list = ValueList({"MALE", "FEMALE"}, selected="FEMALE")
path = FilePath("/Users/briancox/Dropbox/GitHub/MTWABP/Tools/SyntheticAnthropometry/CAESAR/OBJ/")
pyfourdigitoutput_1 = Python3Script(inputPath=path, inputGender=list, inputSlider=Slider(67, range=0..5000))  # -> out, outputFilePath
# ---------- pyfourdigitoutput_1: Python ----------
inputNumber = int(inputSlider)
outputFilePath = f"{inputPath}SPRING_{inputGender}/SPRING{inputNumber:04d}.obj"
# ---------- end pyfourdigitoutput_1 ----------
panel = Panel(pyfourdigitoutput_1.outputFilePath)
_3dm = Import3DM(File=pyfourdigitoutput_1.outputFilePath, Layer="*", Name="*")
scale = Scale(Geometry=_3dm, Center=Point(0, 0, 0), Factor=Slider(100, range=0..1000))  # -> Geometry, Transform
geo = Geometry(scale.Geometry)
demesh = DeconstructMesh(Mesh=geo)  # -> Vertices, Faces, Colours, Normals
pt = Point(<point referenced from the Rhino model>)
cp = ClosestPoint(Point=pt, Cloud=demesh.Vertices)  # -> ClosestPoint, CPIndex, Distance
panel_2 = Panel(cp.CPIndex)
